# Grasshopper definition parathiro_20.05.gh (Grasshopper 1.0.8)
# plug-ins: Pufferfish

number_slider = Slider(2.2, range=1..3)  # disabled
number_slider_2 = Slider(0.1, range=0.05..0.15)  # disabled
number_slider_3 = Slider(0.3, range=0.1..0.5)  # disabled
number_slider_4 = Slider(3, range=1..5)  # disabled
number_slider_5 = Slider(0.07, range=0.03..0.15)  # disabled
number_slider_6 = Slider(0.07, range=0.03..0.15)  # disabled
number_slider_7 = Slider(0.02, range=0.02..0.06)  # disabled
number_slider_8 = Slider(0.03, range=0.01..0.07)  # disabled
number_slider_9 = Slider(0.06, range=0.05..0.1)  # disabled
number_slider_10 = Slider(0.2, range=0.03..0.2)  # disabled
value_list = ValueList({"xoris_ipostilomata": 0, "me_ipostilomata": 1}, selected="me_ipostilomata")  # disabled

number_slider_11 = Slider(2.2, range=1..3)  # disabled
number_slider_12 = Slider(0.1, range=0.05..0.15)  # disabled
number_slider_13 = Slider(0.2, range=0.1..1.1)  # disabled
value_list_2 = ValueList({"porta": 3, "parathiro": 4}, selected="porta")  # disabled

number_slider_14 = Slider(0.07, range=0.03..0.15)  # disabled
number_slider_15 = Slider(0.1, range=0.03..0.15)  # disabled

number_slider_16 = Slider(0.02, range=0.02..0.06)  # disabled
number_slider_17 = Slider(0.03, range=0.01..0.07)  # disabled

# ----
# version_1
# 20.05.2026
number_slider_18 = Slider(2, range=1..5)  # disabled
curve = Curve([<curve referenced from the Rhino model> x3])  # disabled
curve_2 = Curve(<curve referenced from the Rhino model>)  # disabled
cluster = Cluster_2(
    input_crv=curve,
    switch=value_list_2,
    ypsos=number_slider_11,
    frame_diametros=number_slider_12,
    frame_platos=number_slider_13,
    arithmos_anigmata=number_slider_18,
    parathiro_diametros=number_slider_14,
    parathiro_platos=number_slider_15,
    giali_platos=number_slider_16,
    giali_frame=number_slider_17)  # -> result, result_2; disabled
custom_preview = CustomPreview(Geometry=cluster.result, Material=cluster.result_2)  # disabled

curve_3 = Curve([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])  # disabled
value_list_3 = ValueList({"porta": 3, "parathiro": 4}, selected="parathiro")  # disabled
value_list_4 = ValueList({"xoris_ipostilomata": 0, "me_ipostilomata": 1}, selected="me_ipostilomata")
value_list_5 = ValueList({"porta": 3, "parathiro": 4}, selected="parathiro")
ipostiloma_diametros = Number(number_slider_9)  # disabled
switch_porta_parathira = Data(value_list_3)  # disabled
switch_ipostilomata = Data(value_list)  # disabled
parathiro_diametros = Number(number_slider_5)  # disabled
arithmos_anigmata = Number(number_slider_4)  # disabled
ipostiloma_platos = Number(number_slider_10)  # disabled
input_crv = Curve(graft(curve_3))  # disabled
frame_diametros = Number(number_slider_2)  # disabled
parathiro_platos = Number(number_slider_6)  # disabled
frame_platos = Number(number_slider_3)  # disabled
giali_platos = Number(number_slider_7)  # disabled
giali_frame = Number(number_slider_8)  # disabled
ypsos = Number(number_slider)  # disabled
curve_4 = Curve([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])
ypsos_2 = Number(ypsos)  # disabled
get_line = GetLine(curve_4, AtLeast=1, AtMost=1, Realtime=True, TreeAccess=False)
switch_porta_parathira_3_4 = GetNumber(value_list_5, AtLeast=1, AtMost=1, Maximum=4, Minimum=3, TreeAccess=False)
switch_ipostilomata_1_on = GetNumber(value_list_4, AtLeast=1, AtMost=1, Maximum=1.797693135e+308, Minimum=-1.797693135e+308, TreeAccess=False)
ypsos_2_2 = GetNumber(Slider(2.2, range=1..3), AtLeast=1, AtMost=1, Maximum=1.797693135e+308, Minimum=-1.797693135e+308, TreeAccess=False)
frame_diametros_0_10 = GetNumber(
    Slider(0.1, range=0.05..0.15),
    AtLeast=1,
    AtMost=1,
    Maximum=1.797693135e+308,
    Minimum=-1.797693135e+308,
    TreeAccess=False)
frame_platos_0_30 = GetNumber(Slider(0.3, range=0.1..0.5), AtLeast=1, AtMost=1, Maximum=1.797693135e+308, Minimum=-1.797693135e+308, TreeAccess=False)
arithmos_amigmaton_3 = GetNumber(Slider(3, range=1..5), AtLeast=1, AtMost=1, Maximum=1.797693135e+308, Minimum=-1.797693135e+308, TreeAccess=False)
parathiro_diametros_0_07 = GetNumber(
    Slider(0.07, range=0.03..0.15),
    AtLeast=1,
    AtMost=1,
    Maximum=1.797693135e+308,
    Minimum=-1.797693135e+308,
    TreeAccess=False)
parathiro_platos_0_07 = GetNumber(
    Slider(0.07, range=0.03..0.15),
    AtLeast=1,
    AtMost=1,
    Maximum=1.797693135e+308,
    Minimum=-1.797693135e+308,
    TreeAccess=False)
giali_platos_0_03 = GetNumber(
    Slider(0.02, range=0.02..0.06),
    AtLeast=1,
    AtMost=1,
    Maximum=1.797693135e+308,
    Minimum=-1.797693135e+308,
    TreeAccess=False)
giali_frame_0_03 = GetNumber(
    Slider(0.03, range=0.01..0.07),
    AtLeast=1,
    AtMost=1,
    Maximum=1.797693135e+308,
    Minimum=-1.797693135e+308,
    TreeAccess=False)
ipostiloma_diametros_0_06 = GetNumber(
    Slider(0.06, range=0.05..0.1),
    AtLeast=1,
    AtMost=1,
    Maximum=1.797693135e+308,
    Minimum=-1.797693135e+308,
    TreeAccess=False)
ipostiloma_platos_0_20 = GetNumber(Slider(0.2, range=0.03..0.2), AtLeast=1, AtMost=1, Maximum=1.797693135e+308, Minimum=-1.797693135e+308, TreeAccess=False)
end_points = EndPoints(Curve=input_crv)  # -> Start, End; disabled
unit_z = UnitZ(Factor=ypsos_2)  # disabled
negative = Negative(Value=frame_diametros)  # disabled
cluster_2 = Cluster_5(
    input_crv=get_line,
    switch_porta_parathira=switch_porta_parathira_3_4,
    switch_ipostilomata=switch_ipostilomata_1_on,
    ypsos=ypsos_2_2,
    frame_diametros=frame_diametros_0_10,
    frame_platos=frame_platos_0_30,
    arithmos_anigmata=arithmos_amigmaton_3,
    parathiro_diametros=parathiro_diametros_0_07,
    parathiro_platos=parathiro_platos_0_07,
    giali_platos=giali_platos_0_03,
    giali_frame=giali_frame_0_03,
    ipostiloma_diametros=ipostiloma_diametros_0_06,
    ipostiloma_platos=ipostiloma_platos_0_20)  # -> result, result_2
move = Move(Geometry=end_points.End, Motion=unit_z)  # -> Geometry, Transform; disabled
custom_preview_2 = CustomPreview(Geometry=cluster_2.result, Material=cluster_2.result_2)
rectangle_3pt = Rectangle3Pt(PointA=end_points.Start, PointB=end_points.End, PointC=move.Geometry)  # -> Rectangle, Length; disabled
plane_3pt = Plane3Pt(PointA=end_points.Start, PointB=end_points.End, PointC=move.Geometry)  # disabled
brep_edges = BrepEdges(Brep=rectangle_3pt.Rectangle)  # -> Naked, Interior, NonManifold; disabled
curve_middle = CurveMiddle(Curve=brep_edges.Naked)  # disabled
deconstruct = Deconstruct(Point=curve_middle)  # -> XComponent, YComponent, ZComponent; disabled
switch = Data(switch_porta_parathira)  # disabled
sort_list = SortList(Keys=deconstruct.ZComponent, ValuesValuesA=brep_edges.Naked)  # -> Keys, reverse(ValuesValuesA); disabled
split_list = SplitList(List=sort_list.ValuesValuesA, Index=switch)  # -> ListA, ListB; disabled
join_curves = JoinCurves(Curves=split_list.ListA, Preserve=False)  # disabled
frame_platos_2 = Number(frame_platos)  # disabled
frame_diametros_2 = Number(negative)  # disabled
offset_curve = OffsetCurve(Curve=join_curves, Distance=frame_diametros_2, Plane=plane_3pt, Corners=1)  # disabled
merge = Merge(Data1=simplify(graft(join_curves)), Data2=simplify(graft(offset_curve)))  # disabled
cluster_3 = Cluster(curve=offset_curve)  # disabled
amplitude = Amplitude(Vector=plane_3pt, Amplitude=frame_platos_2)  # disabled
loft = Loft(Curves=merge, Options={Adjust=False, Closed=False, LoftEnds=0, LoftSimp=0, LoftType=0, Rebuild=10, Refit=0.01})  # disabled
akriana_crvs = Data(cluster_3)  # disabled
division = Division(A=amplitude, B=2)  # disabled
extrude = Extrude(Base=loft, Direction=amplitude)  # disabled
move_2 = Move(Geometry=akriana_crvs, Motion=division)  # -> Geometry, Transform; disabled
ipostiloma_diametros_2 = Number(ipostiloma_diametros)  # disabled
arithmos_anigmata_2 = Number(arithmos_anigmata)  # disabled
frame = Brep(extrude)  # disabled
switch_ipostilomata_2 = Data(switch_ipostilomata)  # disabled
cluster_4 = Cluster_4(curves=move_2.Geometry, arithmos_anigmata=arithmos_anigmata_2)  # disabled
cluster_5 = Cluster_3(geometry=move_2.Geometry, count=arithmos_anigmata_2, platos_ipostilomaton=ipostiloma_diametros_2)  # -> list_a, list_b; disabled
error = Panel("55")  # disabled
weave = Weave(Pattern=switch_ipostilomata_2, Stream0=error, Stream1=cluster_5.list_b, NullGaps=False)  # disabled
weave_2 = Weave(Pattern=switch_ipostilomata_2, Stream0=cluster_4, Stream1=cluster_5.list_a, NullGaps=False)  # disabled
parathiro_diametros_2 = Number(parathiro_diametros)  # disabled
ipostilomata_srf = Data(weave)  # disabled
negative_2 = Negative(Value=parathiro_diametros_2)  # disabled
curve_5 = Curve(simplify(flatten(weave_2)))  # disabled
offset_curve_2 = OffsetCurve(Curve=simplify(weave_2), Distance=negative_2, Corners=1)  # -> flatten(Curve); disabled
giali_frame_2 = Number(giali_frame)  # disabled
merge_2 = Merge(Data1=graft(curve_5), Data2=graft(offset_curve_2))  # disabled
negative_3 = Negative(Value=giali_frame_2)  # disabled
offset_curve_3 = OffsetCurve(Curve=simplify(offset_curve_2), Distance=negative_3, Corners=1)  # -> flatten(Curve); disabled
loft_2 = Loft(Curves=merge_2, Options={Adjust=False, Closed=False, LoftEnds=0, LoftSimp=0, LoftType=0, Rebuild=10, Refit=0.01})  # disabled
giali_platos_2 = Number(giali_platos)  # disabled
merge_3 = Merge(Data1=graft(offset_curve_2), Data2=graft(offset_curve_3))  # disabled
parathiro_platos_2 = Number(parathiro_platos)  # disabled
loft_3 = Loft(Curves=merge_3, Options={Adjust=False, Closed=False, LoftEnds=0, LoftSimp=0, LoftType=0, Rebuild=10, Refit=0.01})  # disabled
addition = Addition(A=giali_platos_2, B=0.02)  # disabled
ipostiloma_platos_2 = Number(ipostiloma_platos)  # disabled
expression = Expression(x=parathiro_platos_2, Expression="x/2")  # disabled
expression_2 = Expression(x=giali_platos_2, Expression="x/2")  # disabled
expression_3 = Expression(x=ipostiloma_platos_2, Expression="x/2")  # disabled
expression_4 = Expression(x=addition, Expression="x/2")  # disabled
negative_4 = Negative(Value=expression_2)  # disabled
negative_5 = Negative(Value=expression_3)  # disabled
negative_6 = Negative(Value=expression)  # disabled
negative_7 = Negative(Value=expression_4)  # disabled
offset_surface = OffsetSurface(Surface=loft_2, Distance=expression, BothSides=negative_6, CreateSolid=True)  # disabled
offset_surface_2 = OffsetSurface(Surface=loft_3, Distance=expression_4, BothSides=negative_7, CreateSolid=True)  # disabled
offset_surface_3 = OffsetSurface(Surface=offset_curve_3, Distance=expression_2, BothSides=negative_4, CreateSolid=True)  # disabled
offset_surface_4 = OffsetSurface(Surface=ipostilomata_srf, Distance=expression_3, BothSides=negative_5, CreateSolid=True)  # disabled
solid_union = SolidUnion(Breps=offset_surface)  # disabled
solid_union_2 = SolidUnion(Breps=offset_surface_2)  # disabled
ipostiloma_platos_3 = Brep(offset_surface_4)  # disabled
giali_frame_3 = Brep(solid_union_2)  # disabled
parathira = Brep(solid_union)  # disabled
frame_2 = Brep(frame)  # disabled
giali = Brep(offset_surface_3)  # disabled
entwine = Entwine(
    Branch00=frame_2,
    Branch01=parathira,
    Branch02=giali_frame_3,
    Branch03=giali,
    Branch04=ipostiloma_platos_3,
    FlattenInputs=True)  # disabled
metal_material_skouro = ModelMaterial(<model material referenced from the Rhino model>)  # disabled
metal_material_polish = ModelMaterial(<model material referenced from the Rhino model>)  # disabled
glass_material = ModelMaterial(<model material referenced from the Rhino model>)  # disabled
entwine_2 = Entwine(
    Branch00=metal_material_skouro,
    Branch01=metal_material_polish,
    Branch02=metal_material_polish,
    Branch03=glass_material,
    Branch04=metal_material_skouro,
    FlattenInputs=True)  # disabled
custom_preview_3 = CustomPreview(Geometry=entwine, Material=entwine_2)  # disabled

# ==== cluster Cluster
curve = ClusterInput()
explode = Explode(Curve=curve, Recursive=True)  # -> Segments, Vertices
curve_middle = CurveMiddle(Curve=explode.Segments)
deconstruct = Deconstruct(Point=curve_middle)  # -> XComponent, YComponent, ZComponent
sort_list = SortList(Keys=deconstruct.ZComponent, ValuesValuesA=explode.Segments)  # -> Keys, reverse(ValuesValuesA)
list_item = ListItem(List=simplify(sort_list.ValuesValuesA), Index=0, Wrap=True)  # -> Item, Item1, Item2
flip_curve = FlipCurve(Curve=list_item.Item2)  # -> Curve, Flag
merge = Merge(Data1=list_item.Item1, Data2=flip_curve.Curve)
akriana_crvs = Data(merge)
akriana_crvs_2 = ClusterOutput(akriana_crvs)

# ==== cluster Cluster_2
parathiro_diametros = ClusterInput()
arithmos_anigmata = ClusterInput()
input_crv = ClusterInput()
frame_diametros = ClusterInput()
parathiro_platos = ClusterInput()
frame_platos = ClusterInput()
giali_platos = ClusterInput()
giali_frame = ClusterInput()
switch = ClusterInput()
ypsos = ClusterInput()
parathiro_diametros_2 = Number(parathiro_diametros)
arithmos_anigmata_2 = Number(arithmos_anigmata)
input_crv_2 = Curve(graft(input_crv))
frame_diametros_2 = Number(frame_diametros)
parathiro_platos_2 = Number(parathiro_platos)
frame_platos_2 = Number(frame_platos)
giali_platos_2 = Number(giali_platos)
giali_frame_2 = Number(giali_frame)
switch_2 = Data(switch)
ypsos_2 = Number(ypsos)
ypsos_3 = Number(ypsos_2)
end_points = EndPoints(Curve=input_crv_2)  # -> Start, End
unit_z = UnitZ(Factor=ypsos_3)
negative = Negative(Value=frame_diametros_2)
move = Move(Geometry=end_points.End, Motion=unit_z)  # -> Geometry, Transform
rectangle_3pt = Rectangle3Pt(PointA=end_points.Start, PointB=end_points.End, PointC=move.Geometry)  # -> Rectangle, Length
plane_3pt = Plane3Pt(PointA=end_points.Start, PointB=end_points.End, PointC=move.Geometry)
brep_edges = BrepEdges(Brep=rectangle_3pt.Rectangle)  # -> Naked, Interior, NonManifold
curve_middle = CurveMiddle(Curve=brep_edges.Naked)
deconstruct = Deconstruct(Point=curve_middle)  # -> XComponent, YComponent, ZComponent
switch_3 = Data(switch_2)
sort_list = SortList(Keys=deconstruct.ZComponent, ValuesValuesA=brep_edges.Naked)  # -> Keys, reverse(ValuesValuesA)
split_list = SplitList(List=sort_list.ValuesValuesA, Index=switch_3)  # -> ListA, ListB
join_curves = JoinCurves(Curves=split_list.ListA, Preserve=False)
frame_platos_3 = Number(frame_platos_2)
frame_diametros_3 = Number(negative)
offset_curve = OffsetCurve(Curve=join_curves, Distance=frame_diametros_3, Plane=plane_3pt, Corners=1)
cluster = Cluster(curve=offset_curve)
ruled_surface = RuledSurface(CurveA=join_curves, CurveB=offset_curve)
amplitude = Amplitude(Vector=plane_3pt, Amplitude=frame_platos_3)
akriana_crvs = Data(cluster)
division = Division(A=amplitude, B=2)
extrude = Extrude(Base=ruled_surface, Direction=amplitude)
move_2 = Move(Geometry=akriana_crvs, Motion=division)  # -> Geometry, Transform
loft = Loft(Curves=move_2.Geometry, Options={Adjust=False, Closed=False, LoftEnds=0, LoftSimp=0, LoftType=0, Rebuild=10, Refit=0.01})
frame = Brep(extrude)
arithmos_anigmata_3 = Number(arithmos_anigmata_2)
divide_domain² = DivideDomain²(Domain=loft, UCount=arithmos_anigmata_3, VCount=Slider(1, range=1..5))
isotrim = Isotrim(Surface=loft, Domain=divide_domain²)
parathiro_diametros_3 = Number(parathiro_diametros_2)
negative_2 = Negative(Value=parathiro_diametros_3)
curve = Curve(simplify(flatten(isotrim)))
offset_curve_2 = OffsetCurve(Curve=simplify(isotrim), Distance=negative_2, Corners=1)  # -> flatten(Curve)
giali_frame_3 = Number(giali_frame_2)
merge = Merge(Data1=graft(curve), Data2=graft(offset_curve_2))
negative_3 = Negative(Value=giali_frame_3)
offset_curve_3 = OffsetCurve(Curve=simplify(offset_curve_2), Distance=negative_3, Corners=1)  # -> flatten(Curve)
loft_2 = Loft(Curves=merge, Options={Adjust=False, Closed=False, LoftEnds=0, LoftSimp=0, LoftType=0, Rebuild=10, Refit=0.01})
giali_platos_3 = Number(giali_platos_2)
merge_2 = Merge(Data1=graft(offset_curve_2), Data2=graft(offset_curve_3))
parathiro_platos_3 = Number(parathiro_platos_2)
loft_3 = Loft(Curves=merge_2, Options={Adjust=False, Closed=False, LoftEnds=0, LoftSimp=0, LoftType=0, Rebuild=10, Refit=0.01})
addition = Addition(A=giali_platos_3, B=0.02)
expression = Expression(x=parathiro_platos_3, Expression="x/2")
expression_2 = Expression(x=giali_platos_3, Expression="x/2")
expression_3 = Expression(x=addition, Expression="x/2")
negative_4 = Negative(Value=expression_2)
negative_5 = Negative(Value=expression)
negative_6 = Negative(Value=expression_3)
offset_surface = OffsetSurface(Surface=loft_2, Distance=expression, BothSides=negative_5, CreateSolid=True)
offset_surface_2 = OffsetSurface(Surface=loft_3, Distance=expression_3, BothSides=negative_6, CreateSolid=True)
offset_surface_3 = OffsetSurface(Surface=offset_curve_3, Distance=expression_2, BothSides=negative_4, CreateSolid=True)
merge_faces = MergeFaces(Brep=offset_surface)  # -> Breps, Before, After
giali_frame_4 = Brep(offset_surface_2)
parathira = Brep(merge_faces.Breps)
frame_2 = Brep(frame)
giali = Brep(offset_surface_3)
entwine = Entwine(Branch00=frame_2, Branch01=parathira, Branch02=giali_frame_4, Branch03=giali, FlattenInputs=True)
metal_material = ModelMaterial(<model material referenced from the Rhino model>)
glass_material = ModelMaterial(<model material referenced from the Rhino model>)
result = ClusterOutput(entwine)
entwine_2 = Entwine(Branch00=metal_material, Branch01=metal_material, Branch02=metal_material, Branch03=glass_material, FlattenInputs=True)
result_2 = ClusterOutput(entwine_2)

# ==== cluster Cluster_3
geometry = ClusterInput()
length = Length(Curve=geometry)  # -> simplify(Length)
list_item = ListItem(List=flatten(length), Index=0, Wrap=True)
division = Division(A=list_item, B=2)
negative = Negative(Value=division)
unit_z = UnitZ(Factor=negative)
move = Move(Geometry=geometry, Motion=unit_z)  # -> Geometry, Transform
curve_middle = CurveMiddle(Curve=move.Geometry)
list_item_2 = ListItem(List=curve_middle, Index=0, Wrap=True)  # -> Item, Item1
platos_ipostilomaton = ClusterInput()
line = Line(StartPoint=list_item_2.Item, EndPoint=list_item_2.Item1)
platos_ipostilomaton_2 = Number(platos_ipostilomaton)
vector_2pt = Vector2Pt(PointA=list_item_2.Item, PointB=list_item_2.Item1, Unitize=False)  # -> Vector, Length
count = ClusterInput()
division_2 = Division(A=platos_ipostilomaton_2, B=2)
divide_curve = DivideCurve(Curve=line, Count=count, Kinks=False)  # -> Points, Tangents, Parameters
panel = Panel("""-1
0""")
negative_2 = Negative(Value=division_2)
cull_index = CullIndex(List=divide_curve.Points, Indices=panel, Wrap=True)
number = Number(graft(division_2))
number_2 = Number(graft(negative_2))
amplitude = Amplitude(Vector=vector_2pt.Vector, Amplitude=number)
amplitude_2 = Amplitude(Vector=vector_2pt.Vector, Amplitude=number_2)
move_2 = Move(Geometry=cull_index, Motion=amplitude)  # -> Geometry, Transform
move_3 = Move(Geometry=cull_index, Motion=amplitude_2)  # -> Geometry, Transform
merge = Merge(Data1=move_2.Geometry, Data2=move_3.Geometry)
curve_closest_point = CurveClosestPoint(Point=merge, Curve=line)  # -> Point, Parameter, Distance
unit_z_2 = UnitZ(Factor=list_item)
shatter = Shatter(Curve=line, Parameters=curve_closest_point.Parameter)
extrude = Extrude(Base=shatter, Direction=unit_z_2)  # -> simplify(Extrusion)
area = Area(Geometry=extrude)  # -> Area, Centroid
round_to_decimal_place = RoundToDecimalPlace(NumberX=area.Area, DecimalPlace="1", RoundType=0)  # -> Rounded, Difference
sort_list = SortList(Keys=round_to_decimal_place.Rounded)  # -> Keys, ValuesValuesA
list_item_3 = ListItem(List=sort_list.Keys, Index=0, Wrap=True)
larger_than = LargerThan(FirstNumber=round_to_decimal_place.Rounded, SecondNumber=list_item_3)  # -> LargerThan, OrEqualTo
dispatch = Dispatch(List=extrude, DispatchPattern=larger_than.LargerThan)  # -> ListA, ListB
list_a = ClusterOutput(dispatch.ListA)
list_b = ClusterOutput(dispatch.ListB)

# ==== cluster Cluster_4
curves = ClusterInput()
loft = Loft(Curves=curves, Options={Adjust=False, Closed=False, LoftEnds=0, LoftSimp=0, LoftType=0, Rebuild=10, Refit=0.01})
arithmos_anigmata = ClusterInput()
arithmos_anigmata_2 = Number(arithmos_anigmata)
divide_domain² = DivideDomain²(Domain=loft, UCount=arithmos_anigmata_2, VCount="1")
isotrim = Isotrim(Surface=loft, Domain=divide_domain²)
surface = ClusterOutput(isotrim)

# ==== cluster Cluster_5
ipostiloma_diametros = ClusterInput()
switch_porta_parathira = ClusterInput()
switch_ipostilomata = ClusterInput()
parathiro_diametros = ClusterInput()
arithmos_anigmata = ClusterInput()
ipostiloma_platos = ClusterInput()
input_crv = ClusterInput()
frame_diametros = ClusterInput()
parathiro_platos = ClusterInput()
frame_platos = ClusterInput()
giali_platos = ClusterInput()
giali_frame = ClusterInput()
ypsos = ClusterInput()
ipostiloma_diametros_2 = Number(ipostiloma_diametros)
switch_porta_parathira_2 = Data(switch_porta_parathira)
switch_ipostilomata_2 = Data(switch_ipostilomata)
parathiro_diametros_2 = Number(parathiro_diametros)
arithmos_anigmata_2 = Number(arithmos_anigmata)
ipostiloma_platos_2 = Number(ipostiloma_platos)
input_crv_2 = Curve(graft(input_crv))
frame_diametros_2 = Number(frame_diametros)
parathiro_platos_2 = Number(parathiro_platos)
frame_platos_2 = Number(frame_platos)
giali_platos_2 = Number(giali_platos)
giali_frame_2 = Number(giali_frame)
ypsos_2 = Number(ypsos)
ypsos_3 = Number(ypsos_2)
end_points = EndPoints(Curve=input_crv_2)  # -> Start, End
unit_z = UnitZ(Factor=ypsos_3)
negative = Negative(Value=frame_diametros_2)
move = Move(Geometry=end_points.End, Motion=unit_z)  # -> Geometry, Transform
rectangle_3pt = Rectangle3Pt(PointA=end_points.Start, PointB=end_points.End, PointC=move.Geometry)  # -> Rectangle, Length
plane_3pt = Plane3Pt(PointA=end_points.Start, PointB=end_points.End, PointC=move.Geometry)
brep_edges = BrepEdges(Brep=rectangle_3pt.Rectangle)  # -> Naked, Interior, NonManifold
curve_middle = CurveMiddle(Curve=brep_edges.Naked)
deconstruct = Deconstruct(Point=curve_middle)  # -> XComponent, YComponent, ZComponent
switch = Data(switch_porta_parathira_2)
sort_list = SortList(Keys=deconstruct.ZComponent, ValuesValuesA=brep_edges.Naked)  # -> Keys, reverse(ValuesValuesA)
split_list = SplitList(List=sort_list.ValuesValuesA, Index=switch)  # -> ListA, ListB
join_curves = JoinCurves(Curves=split_list.ListA, Preserve=False)
frame_platos_3 = Number(frame_platos_2)
frame_diametros_3 = Number(negative)
offset_curve = OffsetCurve(Curve=join_curves, Distance=frame_diametros_3, Plane=plane_3pt, Corners=1)
merge = Merge(Data1=simplify(graft(join_curves)), Data2=simplify(graft(offset_curve)))
cluster = Cluster(curve=offset_curve)
amplitude = Amplitude(Vector=plane_3pt, Amplitude=frame_platos_3)
loft = Loft(Curves=merge, Options={Adjust=False, Closed=False, LoftEnds=0, LoftSimp=0, LoftType=0, Rebuild=10, Refit=0.01})
akriana_crvs = Data(cluster)
division = Division(A=amplitude, B=2)
extrude = Extrude(Base=loft, Direction=amplitude)
move_2 = Move(Geometry=akriana_crvs, Motion=division)  # -> Geometry, Transform
ipostiloma_diametros_3 = Number(ipostiloma_diametros_2)
arithmos_anigmata_3 = Number(arithmos_anigmata_2)
frame = Brep(extrude)
switch_ipostilomata_3 = Data(switch_ipostilomata_2)
cluster_2 = Cluster_4(curves=move_2.Geometry, arithmos_anigmata=arithmos_anigmata_3)
cluster_3 = Cluster_3(geometry=move_2.Geometry, count=arithmos_anigmata_3, platos_ipostilomaton=ipostiloma_diametros_3)  # -> list_a, list_b
error = Panel("55")
weave = Weave(Pattern=switch_ipostilomata_3, Stream0=error, Stream1=cluster_3.list_b, NullGaps=False)
weave_2 = Weave(Pattern=switch_ipostilomata_3, Stream0=cluster_2, Stream1=cluster_3.list_a, NullGaps=False)
parathiro_diametros_3 = Number(parathiro_diametros_2)
ipostilomata_srf = Data(weave)
negative_2 = Negative(Value=parathiro_diametros_3)
curve = Curve(simplify(flatten(weave_2)))
offset_curve_2 = OffsetCurve(Curve=simplify(weave_2), Distance=negative_2, Corners=1)  # -> flatten(Curve)
giali_frame_3 = Number(giali_frame_2)
merge_2 = Merge(Data1=graft(curve), Data2=graft(offset_curve_2))
negative_3 = Negative(Value=giali_frame_3)
offset_curve_3 = OffsetCurve(Curve=simplify(offset_curve_2), Distance=negative_3, Corners=1)  # -> flatten(Curve)
loft_2 = Loft(Curves=merge_2, Options={Adjust=False, Closed=False, LoftEnds=0, LoftSimp=0, LoftType=0, Rebuild=10, Refit=0.01})
giali_platos_3 = Number(giali_platos_2)
merge_3 = Merge(Data1=graft(offset_curve_2), Data2=graft(offset_curve_3))
parathiro_platos_3 = Number(parathiro_platos_2)
loft_3 = Loft(Curves=merge_3, Options={Adjust=False, Closed=False, LoftEnds=0, LoftSimp=0, LoftType=0, Rebuild=10, Refit=0.01})
addition = Addition(A=giali_platos_3, B=0.02)
ipostiloma_platos_3 = Number(ipostiloma_platos_2)
expression = Expression(x=parathiro_platos_3, Expression="x/2")
expression_2 = Expression(x=giali_platos_3, Expression="x/2")
expression_3 = Expression(x=ipostiloma_platos_3, Expression="x/2")
expression_4 = Expression(x=addition, Expression="x/2")
negative_4 = Negative(Value=expression_2)
negative_5 = Negative(Value=expression_3)
negative_6 = Negative(Value=expression)
negative_7 = Negative(Value=expression_4)
offset_surface = OffsetSurface(Surface=loft_2, Distance=expression, BothSides=negative_6, CreateSolid=True)
offset_surface_2 = OffsetSurface(Surface=loft_3, Distance=expression_4, BothSides=negative_7, CreateSolid=True)
offset_surface_3 = OffsetSurface(Surface=offset_curve_3, Distance=expression_2, BothSides=negative_4, CreateSolid=True)
offset_surface_4 = OffsetSurface(Surface=ipostilomata_srf, Distance=expression_3, BothSides=negative_5, CreateSolid=True)
solid_union = SolidUnion(Breps=offset_surface)
solid_union_2 = SolidUnion(Breps=offset_surface_2)
ipostiloma_platos_4 = Brep(offset_surface_4)
giali_frame_4 = Brep(solid_union_2)
parathira = Brep(solid_union)
frame_2 = Brep(frame)
giali = Brep(offset_surface_3)
entwine = Entwine(
    Branch00=frame_2,
    Branch01=parathira,
    Branch02=giali_frame_4,
    Branch03=giali,
    Branch04=ipostiloma_platos_4,
    FlattenInputs=True)
metal_material_skouro = ModelMaterial(<model material referenced from the Rhino model>)
metal_material_polish = ModelMaterial(<model material referenced from the Rhino model>)
glass_material = ModelMaterial(<model material referenced from the Rhino model>)
result = ClusterOutput(entwine)
entwine_2 = Entwine(
    Branch00=metal_material_skouro,
    Branch01=metal_material_polish,
    Branch02=metal_material_polish,
    Branch03=glass_material,
    Branch04=metal_material_skouro,
    FlattenInputs=True)
result_2 = ClusterOutput(entwine_2)
